# Grasshopper definition SampleGHClash.gh (Grasshopper 1.0.7)

# ---- group: RH_IN:collisionMeshes
mesh = Mesh()

# ---- group: RH_IN:mainMesh
mesh_2 = Mesh()

# ----
clash = Clash(FirstSet=mesh_2, SecondSet=mesh, Distance=0, L=100)  # -> ClashCount, ClashPoints, ClashRadii, FirstIndex, SecondIndex
item = ListItem(List=mesh, Index=clash.SecondIndex, Wrap=True)

# ---- group: RH_OUT:meshes
mesh_3 = Mesh(item)
